test file "EV_SysLevel_MiL"

suite "Activate_Sport_Mode"

  case "SportMode_VCUMessageSent" [baseline]
    model EV_ControlSystem_Architecture, harness EV_ControlSystem_Architecture_Harness1
    post-load callback:
      value = 'normalToSportMode';

      blk1 = 'EV_ControlSystem_Architecture_Harness1/BatteryDetails';
      blk2 = 'EV_ControlSystem_Architecture_Harness1/Vehicle Emulator/VehicleDetaiils';
      blk3 = 'EV_ControlSystem_Architecture_Harness1/driverInput';
      blk4 = 'EV_ControlSystem_Architecture_Harness1/Subsystem/Scenario';

      set_param(blk1,'ActiveScenario',value);
      set_param(blk2,'ActiveScenario',value);
      sltest.testsequence.activateScenario(blk3,value);
      set_param(blk4,'MaskDisplay',['disp("Active Mode: ' value '")']);
    assessment "Assessment1": At any point of time, if driverMode == int8(1) becomes true then, with no delay, BMS_State_Request == 3 must be true
      driverMode: signal EV_ControlSystem_Architecture_Harness1/driverInput, port 1
      BMS_State_Request: signal EV_ControlSystem_Architecture_Harness1/Cast To Double, port 1

  case "SportMode_Denied_lowSOC" [baseline]
    model EV_ControlSystem_Architecture, harness EV_ControlSystem_Architecture_Harness1
    parameter set "Parameter Set 1": SOCInit = 0.18  % BMS_Software_DD.sldd
    post-load callback: same code as in post-load callback of case "SportMode_VCUMessageSent"
    assessment "Assessment2": At any point of time, BMS_State_Request must be less than 3
      BMS_State_Request: signal EV_ControlSystem_Architecture_Harness1/Cast To Double, port 1

  case "SportMode_BMS_CurrentLimUp" [baseline]
    model EV_ControlSystem_Architecture, harness EV_ControlSystem_Architecture_Harness1
    post-load callback: same code as in post-load callback of case "SportMode_VCUMessageSent"
    assessment "Assessment1": At any point of time, if driverMode == int8(1) becomes true then, with no delay, BMS_maxDischrgCurrent == single(-527) must be true
      driverMode: signal EV_ControlSystem_Architecture_Harness1/driverInput, port 1
      BMS_maxDischrgCurrent: signal EV_ControlSystem_Architecture_Harness1/Bus Selector, port 2

suite "Vehicle_Response_on_ModeActivation"

  case "SportMode_0to60time" [baseline]
    model EV_ControlSystem_Architecture, harness EV_ControlSystem_Architecture_Harness1
    post-load callback:
      value = 'sportMode';

      blk1 = 'EV_ControlSystem_Architecture_Harness1/BatteryDetails';
      blk2 = 'EV_ControlSystem_Architecture_Harness1/Vehicle Emulator/VehicleDetaiils';
      blk3 = 'EV_ControlSystem_Architecture_Harness1/driverInput';
      blk4 = 'EV_ControlSystem_Architecture_Harness1/Subsystem/Scenario';

      set_param(blk1,'ActiveScenario',value);
      set_param(blk2,'ActiveScenario',value);
      sltest.testsequence.activateScenario(blk3,value);
      set_param(blk4,'MaskDisplay',['disp("Active Mode: ' value '")']);
    assessment "Assessment2": At any point of time, accTime <= 4.85 must be true
      accTime: signal EV_ControlSystem_Architecture_Harness1/AccTime/Bias, port 1