test file "BMS_Tests"
  coverage: Decision, MCDC, Condition

suite "BMS_Software_State_Machine"

  case "BMS_Harness_StateMachine_1" [simulation]
    model BMS_Software, harness BMS_Harness_StateMachine_1 (for BMS_Software/State_Machine)
    signal scenario: Charging (BMS_Harness_StateMachine_1/Input_TestConditions)
    iterations:
      Charging: SignalBuilderGroup "Charging"
      ChargingToFault: SignalBuilderGroup "ChargingToFault"
      Driving: SignalBuilderGroup "Driving"
      DrivingToFault: SignalBuilderGroup "DrivingToFault"
      Standby: SignalBuilderGroup "Standby"
      StandbyToFault: SignalBuilderGroup "StandbyToFault"

  case "BMS_Harness_StateMachine_2" [simulation]
    model BMS_Software, harness BMS_Harness_StateMachine_2 (for BMS_Software/State_Machine)
    iterations:
      Iteration1: TestSequenceScenario "Standby"
      Iteration2: TestSequenceScenario "StandbyToFault"
      Iteration3: TestSequenceScenario "Charging"
      Iteration4: TestSequenceScenario "ChargingToFault"
      Iteration5: TestSequenceScenario "Driving"
      Iteration6: TestSequenceScenario "DrivingToFault"
      Iteration7: TestSequenceScenario "ChargingToStandby"
      Iteration8: TestSequenceScenario "DrivingtoStandby"

  case "BMS_Harness_StateMachine_3" [simulation]
    model BMS_Software, harness BMS_Harness_StateMachine_1 (for BMS_Software/State_Machine)
    signal scenario: Charging (BMS_Harness_StateMachine_1/Input_TestConditions)
    iterations:
      Charging: SignalBuilderGroup "Charging"
      ChargingToFault: SignalBuilderGroup "ChargingToFault"
      Driving: SignalBuilderGroup "Driving"
      DrivingToFault: SignalBuilderGroup "DrivingToFault"
      Standby: SignalBuilderGroup "Standby"
      StandbyToFault: SignalBuilderGroup "StandbyToFault"

  case "BMS_Harness_StateMachine_4" [simulation]
    model BMS_Software, harness BMS_Harness_StateMachine_2 (for BMS_Software/State_Machine)
    iterations:
      Iteration1: TestSequenceScenario "Standby"
      Iteration2: TestSequenceScenario "StandbyToFault"
      Iteration3: TestSequenceScenario "Charging"
      Iteration4: TestSequenceScenario "ChargingToFault"
      Iteration5: TestSequenceScenario "Driving"
      Iteration6: TestSequenceScenario "DrivingToFault"
      Iteration7: TestSequenceScenario "ChargingToStandby"
      Iteration8: TestSequenceScenario "DrivingtoStandby"

suite "BMS_Software_ContactorManagement" (disabled)

  suite "BMS_Harness_ContactorMgmt" (disabled)

    case "BMS_Harness_ContactorMgmt" [simulation] (disabled)
      model BMS_Software, harness BMS_Harness_ContactorMgmt (for BMS_Software/ContactorManagement)
      signal scenario: Charging (BMS_Harness_ContactorMgmt/Test Inputs)
      iterations:
        Charging: SignalBuilderGroup "Charging"
        ChargingToDriving: SignalBuilderGroup "ChargingToDriving"
        ChargingToStandby: SignalBuilderGroup "ChargingToStandby"
        Driving: SignalBuilderGroup "Driving"
        DrivingToCharging: SignalBuilderGroup "DrivingToCharging"
        DrivingToStandby: SignalBuilderGroup "DrivingToStandby"
        Standby: SignalBuilderGroup "Standby"

suite "BMS_Software_PowerCalc"

  case "BMS_Harness_PowerCalc_0" [simulation]
    model BMS_Software, harness BMS_Harness_PowerCalc (for BMS_Software/CurrPowerLimCalc)
    parameter set "Parameter Set 1": MaxChrgCurrLimit = 2.7  % BMS_Software_DD.sldd
    parameter set "Parameter Set 2": MaxChrgCurrLimit = 3.0  % BMS_Software_DD.sldd
    parameter set "Parameter Set 3": MaxChrgCurrLimit = 3.1  % BMS_Software_DD.sldd
    parameter set "Parameter Set 4": MaxChrgCurrLimit = 3.15  % BMS_Software_DD.sldd
    parameter set "Parameter Set 5": MaxChrgCurrLimit = 3.2  % BMS_Software_DD.sldd
    parameter set "Parameter Set 6": MaxChrgCurrLimit = 3.25  % BMS_Software_DD.sldd
    parameter set "Parameter Set 7": MaxChrgCurrLimit = 3.3  % BMS_Software_DD.sldd
    parameter set "Parameter Set 10" (off): MaxChrgCurrLimit = 2.8  % BMS_Software_DD.sldd
    parameter set "Parameter Set 11" (off): MaxChrgCurrLimit = 2.9  % BMS_Software_DD.sldd
    assessment "Assessment1": At any point of time, maxcurrent must be greater than or equal to single(-1000) and less than or equal to single(1000)
      maxcurrent: signal BMS_Harness_PowerCalc/Bus Selector, port 1
    iterations:
      Iteration1: ParameterSet "Parameter Set 1"
      Iteration2: ParameterSet "Parameter Set 2"
      Iteration3: ParameterSet "Parameter Set 3"
      Iteration4: ParameterSet "Parameter Set 4"
      Iteration5: ParameterSet "Parameter Set 5"
      Iteration6: ParameterSet "Parameter Set 6"
      Iteration7: ParameterSet "Parameter Set 7"
      Iteration8: ParameterSet "Parameter Set 10"
      Iteration9: ParameterSet "Parameter Set 11"

  case "BMS_Harness_PowerCalc_Baseline" [baseline] (disabled)
    model BMS_Software, harness BMS_Harness_PowerCalc (for BMS_Software/CurrPowerLimCalc), stop time 100
    assessment "Assessment1": At any point of time, maxDschrg must be greater than or equal to single(-185)
      maxDschrg: signal BMS_Harness_PowerCalc/Bus Selector, port 1

  case "BMS_Harness_PowerCalc_SportMode" [baseline]
    model BMS_Software, harness BMS_Harness_PowerCalc (for BMS_Software/CurrPowerLimCalc), stop time 100
    assessment "Assessment1": At any point of time, maxDschrg must be greater than or equal to single(-400)
      maxDschrg: signal BMS_Harness_PowerCalc/Bus Selector, port 1

suite "BMS_Software_Whole"

  case "BMS_Haeness_Full_SportMode" [baseline]
    model BMS_Software, harness BMS_Harness_fullBMS, stop time 2000
    parameter set "Parameter Set 1": StateReq = 3  % BMS_Software_DD.sldd
    baseline "FullBMS_SportMode.mat" (14 of 36 signals compared)
      BMS_State
      BalCmd
      ChargeCurrentReq
      ChargeMode
      DischargeCurrentLimit
      ChargeCurrentLimit
      SOC_Est
      cell_temps1
      cell_temps2
      cell_temps3
      HighTempDchrgCurrentLim
      LowTempDchrgCurrentLim
      MinCellVoltDchrgCurrentLim
      SOC_CC
    assessment "Assessment1" (off): At any point of time, maxDsChrg must be greater than single(-315)
    assessment "Assessment2" (off): At any point of time, cellTemp3 <single(15) must be true, with no delay, 1>0 must be true
      maxDsChrg: signal BMS_Harness_fullBMS/Output Conversion Subsystem, port 1, element maxDsChrg.DischargeCurrentLimit
      cellTemp3: signal BMS_Harness_fullBMS/sysInputs/CellTemp Sensors/Step, port 1, element cellTemp3.FinalValue

  case "BMS_Haeness_Full_ComfortMode" [baseline] (disabled)
    model BMS_Software, harness BMS_Harness_fullBMS, stop time 2000
    baseline "FullBMS_ComfortMode.mat" (15 of 36 signals compared)
      BMS_State
      BalCmd
      ChargeCurrentReq
      ChargeMode
      DischargeCurrentLimit
      ChargeCurrentLimit
      PackOverCurrFlt
      SOC_Est
      cell_temps1
      cell_temps2
      cell_temps3
      HighTempDchrgCurrentLim
      LowTempDchrgCurrentLim
      MinCellVoltDchrgCurrentLim
      SOC_CC
    assessment "Assessment1" (off): At any point of time, maxDsChrg must be greater than single(-315)
    assessment "Assessment2" (off): At any point of time, cellTemp3 <single(15) must be true, with no delay, 1>0 must be true
      maxDsChrg: signal BMS_Harness_fullBMS/Output Conversion Subsystem, port 1, element maxDsChrg.DischargeCurrentLimit
      cellTemp3: signal BMS_Harness_fullBMS/sysInputs/CellTemp Sensors/Step, port 1, element cellTemp3.FinalValue