test file "BMS_Tests_SiL"
  setup callback:
    scrubSharedUtils
  coverage: Decision, Condition

suite "BMS_Software"

  case "BMS_Harness_fullBMS" [equivalence]
    simulation 1:
      model BMS_Software, harness BMS_Harness_fullBMS, stop time 500
      parameter set "Parameter Set 1": cellVoltBasic = 3.6  % BMS_Software_DD.sldd
      parameter set "Parameter Set 2": cellVoltBasic = 3.7  % BMS_Software_DD.sldd
      parameter set "Parameter Set 3": cellVoltBasic = 3.8  % BMS_Software_DD.sldd
      parameter set "Parameter Set 4": cellVoltBasic = 3.5  % BMS_Software_DD.sldd
      parameter set "Parameter Set 5": cellVoltBasic = 3.4  % BMS_Software_DD.sldd
    simulation 2:
      model BMS_Software, harness BMS_Harness_fullBMS, mode Accelerator, stop time 500
      parameter set "Parameter Set 1": cellVoltBasic = 3.6  % BMS_Software_DD.sldd
      parameter set "Parameter Set 2": cellVoltBasic = 3.7  % BMS_Software_DD.sldd
      parameter set "Parameter Set 3": cellVoltBasic = 3.8  % BMS_Software_DD.sldd
      parameter set "Parameter Set 4": cellVoltBasic = 3.5  % BMS_Software_DD.sldd
      parameter set "Parameter Set 5": cellVoltBasic = 3.4  % BMS_Software_DD.sldd
    equivalence criteria (6 of 118 signals compared)
      SOC_CC
      CurrentLimits.DischargeCurrentLimit
      CurrentLimits.ChargeCurrentLimit
      Faults.PackOverCurrFlt
      Faults.CellHighTempFlt
      ChargeMode
    iterations:
      Iteration1: ParameterSet "Parameter Set 1"
      Iteration2: ParameterSet "Parameter Set 2"
      Iteration3: ParameterSet "Parameter Set 3"
      Iteration4: ParameterSet "Parameter Set 4"
      Iteration5: ParameterSet "Parameter Set 5"