test file "EV2M_VCU_MiLtests"

suite "VCU_2EMEV_ctrl_powertrain"

  case "VCU_2EMEV_Harness_Baseline" [baseline] (disabled)
    model VCU_Software, harness VCU_Software_Harness1, stop time 600
    parameter set "Parameter Set 1": Drv_Mode = 0  % EvVCU_ModelSpecific.sldd
    baseline "FullVCU_Normal_Mode.mat" (5 of 8 signals compared)
      EMTrqCmd
      VcuBrkPrsCmd
      Cltch1Cmd
      Neutral
      SRE

  case "VCU_2EMEV_Harness_HighRegen" [baseline]
    model VCU_Software, harness VCU_Software_Harness1, stop time 600
    parameter set "Parameter Set 1": Drv_Mode = 1  % EvVCU_ModelSpecific.sldd
    baseline "FullVCU_Sport_Mode.mat" (5 of 8 signals compared)
      EMTrqCmd
      VcuBrkPrsCmd
      Cltch1Cmd
      Neutral
      SRE